% Requirement links of F16AFuelVerificationTest.m (R2026a)

% lines 26-34 verifies f16a_physical_derived.slreqx#2
        function testFuelSufficientForMission(testCase)
            % REQ_F16A_P01: available internal fuel shall be >= mission fuel.
            available = F16APhysicalFuelRollup().AvailableFuel_lb;
            required  = F16APhysicalMissionFuel();
            msg = sprintf("REQ_F16A_P01 verification PENDING: available=%.0f lb, " + ...
                "required=%g. Connect F16APhysicalMissionFuel to the /sizing/ " + ...
                "mission analysis (it returns NaN until then).", available, required);
            testCase.verifyGreaterThanOrEqual(available, required, msg);
        end